# Grasshopper definition laserball.gh (Grasshopper 0.9.80)

number_slider = Slider(2.047, range=0..10)
number_slider_2 = Slider(5.35, range=0..6.28)
point = Point(<point referenced from the Rhino model>)
point_2 = Point(<point referenced from the Rhino model>)
construct_domain = ConstructDomain(DomainStart=expr("-x/2", number_slider), DomainEnd=expr("x/2", number_slider))
rotate_plane = RotatePlane(Plane=point, Angle=number_slider_2)
rotate_plane_2 = RotatePlane(Plane=point_2, Angle=number_slider_2)
rectangle = Rectangle(Plane=rotate_plane, XSize=Slider(23.821, range=0..80), YSize=construct_domain, Radius=0)  # -> Rectangle, Length
rectangle_2 = Rectangle(Plane=rotate_plane_2, XSize=Slider(-23.821, range=-80..0), YSize=construct_domain, Radius=0)  # -> Rectangle, Length
vector = Vector(Vector(24.91725065, -41.39063297, 0))
move = Move(Geometry=rectangle.Rectangle, Motion=vector)  # -> Geometry, Transform
number_slider_3 = Slider(141.591, range=0..360)
move_2 = Move(Geometry=rectangle_2.Rectangle, Motion=vector)  # -> Geometry, Transform
number = Number(6)
polar_array = PolarArray(Geometry=move.Geometry, Plane=rotate_plane, Count=number, Angle=degrees(number_slider_3))  # -> Geometry, Transform
polar_array_2 = PolarArray(Geometry=move_2.Geometry, Plane=rotate_plane_2, Count=number, Angle=degrees(number_slider_3))  # -> Geometry, Transform
curve = Curve(<curve referenced from the Rhino model>)
curve_2 = Curve(<curve referenced from the Rhino model>)
region_difference = RegionDifference(CurvesA=curve, CurvesB=polar_array.Geometry)
region_difference_2 = RegionDifference(CurvesA=curve_2, CurvesB=polar_array_2.Geometry)
