# Grasshopper definition rigidheddle.gh (Grasshopper 0.9.80)

# ---- group: change this to adjust dpi
number_of_dents_per_10cm = Slider(20, range=1..61)

# ----
width_of_section_in_mm = Slider(100, range=0..320)
height_of_heddle_180 = Number(180)
height_of_dent_150 = Number(150)
division = Division(A=number_of_dents_per_10cm, B=2)
division_2 = Division(A=width_of_section_in_mm, B=division)

# ---- group: width of cutout
division_3 = Division(A=division_2, B=4)

# ----
division_4 = Division(A=division_3, B=2)
division_5 = Division(A=division_3, B=2)
unit_x = UnitX(Factor=division_5)

# ---- group: round cutout
ellipse = Ellipse(Plane=PlaneXY(0, 0, 0), Radius1=division_4, Radius2=5)  # -> Ellipse, Focus1, Focus2

# ---- group: width of cutout x4
multiplication = Multiplication(A=division_3, B=4)

# ---- group: width of cutout x3
multiplication_2 = Multiplication(A=division_3, B=3)

# ----
vector_xyz = VectorXYZ(XComponent=division_3, YComponent=90, ZComponent=0)  # -> Vector, Length
move = Move(Geometry=ellipse.Ellipse, Motion=unit_x)  # -> Geometry, Transform
unit_x_2 = UnitX(Factor=multiplication)

# ---- group: tall cutout
rectangle = Rectangle(Plane=PlaneXY(0, 0, 0), XSize=division_3, YSize=height_of_dent_150, Radius=0)  # -> Rectangle, Length

# ----
unit_x_3 = UnitX(Factor=multiplication_2)
rectangle_2 = Rectangle(Plane=PlaneXY(0, 0, 0), XSize=Domain(0, 30), YSize=Domain(0, 20), Radius=0)  # -> Rectangle, Length
rectangle_3 = Rectangle(Plane=PlaneXY(0, 0, 0), XSize=Domain(0, 30), YSize=Domain(0, 20), Radius=0)  # -> Rectangle, Length
circle = Circle(Plane=PlaneXY(0, 0, 0), Radius=2)
linear_array = LinearArray(Geometry=rectangle.Rectangle, Direction=unit_x_2, Count=division)  # -> Geometry, Transform
vector_xyz_2 = VectorXYZ(XComponent=unit_x_3, YComponent=15, ZComponent=0)  # -> Vector, Length
move_2 = Move(Geometry=move.Geometry, Motion=vector_xyz.Vector)  # -> Geometry, Transform
vector_xyz_3 = VectorXYZ(XComponent=-30, YComponent=160, ZComponent=0)  # -> Vector, Length
vector_xyz_4 = VectorXYZ(XComponent=100, YComponent=160, ZComponent=0)  # -> Vector, Length
vector_xyz_5 = VectorXYZ(XComponent=15, YComponent=10, ZComponent=0)  # -> Vector, Length
vector_xyz_6 = VectorXYZ(XComponent=82.5, YComponent=10, ZComponent=0)  # -> Vector, Length
vector_xyz_7 = VectorXYZ(XComponent=15, YComponent=170, ZComponent=0)  # -> Vector, Length
vector_xyz_8 = VectorXYZ(XComponent=82.5, YComponent=170, ZComponent=0)  # -> Vector, Length
vector_xyz_9 = VectorXYZ(XComponent=50, YComponent=10, ZComponent=0)  # -> Vector, Length
vector_xyz_10 = VectorXYZ(XComponent=50, YComponent=170, ZComponent=0)  # -> Vector, Length
vector_xyz_11 = VectorXYZ(XComponent=17.5, YComponent=10, ZComponent=0)  # -> Vector, Length
vector_xyz_12 = VectorXYZ(XComponent=85, YComponent=10, ZComponent=0)  # -> Vector, Length
vector_xyz_13 = VectorXYZ(XComponent=17.5, YComponent=170, ZComponent=0)  # -> Vector, Length
vector_xyz_14 = VectorXYZ(XComponent=85, YComponent=170, ZComponent=0)  # -> Vector, Length
unit_x_4 = UnitX(Factor=-30)
unit_x_5 = UnitX(Factor=100)

# ---- group: bake for entire section cutouts
move_3 = Move(Geometry=linear_array.Geometry, Motion=vector_xyz_2.Vector)  # -> Geometry, Transform
linear_array_2 = LinearArray(Geometry=move_2.Geometry, Direction=unit_x_2, Count=division)  # -> Geometry, Transform
heddle_section = Rectangle(Plane=PlaneXY(0, 0, 0), XSize=width_of_section_in_mm, YSize=height_of_heddle_180, Radius=0)  # -> Rectangle, Length

# ---- group: left tabs for heddle bar
move_4 = Move(Geometry=rectangle_2.Rectangle, Motion=unit_x_4)  # -> Geometry, Transform
move_5 = Move(Geometry=rectangle_3.Rectangle, Motion=vector_xyz_3.Vector)  # -> Geometry, Transform

# ---- group: right tabs for heddle bar
move_6 = Move(Geometry=rectangle_2.Rectangle, Motion=unit_x_5)  # -> Geometry, Transform
move_7 = Move(Geometry=rectangle_3.Rectangle, Motion=vector_xyz_4.Vector)  # -> Geometry, Transform

# ---- group: holes for left section
move_8 = Move(Geometry=circle, Motion=vector_xyz_5.Vector)  # -> Geometry, Transform
move_9 = Move(Geometry=circle, Motion=vector_xyz_6.Vector)  # -> Geometry, Transform
move_10 = Move(Geometry=circle, Motion=vector_xyz_7.Vector)  # -> Geometry, Transform
move_11 = Move(Geometry=circle, Motion=vector_xyz_8.Vector)  # -> Geometry, Transform

# ---- group: holes for center section
move_12 = Move(Geometry=circle, Motion=vector_xyz_9.Vector)  # -> Geometry, Transform
move_13 = Move(Geometry=circle, Motion=vector_xyz_10.Vector)  # -> Geometry, Transform

# ---- group: holes for right section
move_14 = Move(Geometry=circle, Motion=vector_xyz_11.Vector)  # -> Geometry, Transform
move_15 = Move(Geometry=circle, Motion=vector_xyz_12.Vector)  # -> Geometry, Transform
move_16 = Move(Geometry=circle, Motion=vector_xyz_13.Vector)  # -> Geometry, Transform
move_17 = Move(Geometry=circle, Motion=vector_xyz_14.Vector)  # -> Geometry, Transform
