# Grasshopper definition starlamp.gh (Grasshopper 0.9.80)

material_thickness = Slider(3.2, range=0..5)
slot_neck_width = Slider(6, range=0..50)
slot_head_length = Slider(12, range=0..50)
slot_long_length = Slider(30, range=0..70)

# ---- group: 3D Box Morph
geometry = Geometry(<curve referenced from the Rhino model>)
box = Box({Plane=Plane(origin=(-657, -90, 0), x=(0, 1, 0), y=(1, 0, 0)), X=Domain(0, 44), Y=Domain(0, 44), Z=Domain(-11, 0)})
surface = Surface(<surface referenced from the Rhino model>)
divide_domain² = DivideDomain²(Domain=surface, UCount=Slider(15, range=0..20), VCount=Slider(6, range=1..21))
surface_box = SurfaceBox(Surface=surface, Domain=divide_domain², Height=1)
box_morph = BoxMorph(Geometry=geometry, Reference=box, Target=surface_box)

# ----
origin_point = Point(Point(0, 0, 0))
dom = Domain(DomainStart=expr("-x/2", slot_neck_width), DomainEnd=expr("x/2", slot_neck_width))

# ---- group: master slot
dom_2 = Domain(DomainStart=expr("-x/2", slot_head_length), DomainEnd=expr("x/2", slot_head_length))
dom_3 = Domain(DomainStart=expr("-x/2", slot_long_length), DomainEnd=expr("x/2", slot_long_length))
dom_4 = Domain(DomainStart=expr("-x/2", material_thickness), DomainEnd=expr("x/2", material_thickness))
slot_head_rect = Rectangle(Plane=origin_point, XSize=dom_2, YSize=material_thickness, Radius=0)  # -> Rectangle, Length
slot_neck_rect = Rectangle(Plane=origin_point, XSize=dom, YSize=material_thickness, Radius=0)  # -> Rectangle, Length
slot_long_rect = Rectangle(Plane=origin_point, XSize=dom_3, YSize=material_thickness, Radius=0)  # -> Rectangle, Length
vector_xyz = VectorXYZ(XComponent=expr("x/2", 0), YComponent=expr("x*2", material_thickness), ZComponent=0)  # -> Vector, Length
vector_xyz_2 = VectorXYZ(XComponent=expr("x/2", 0), YComponent=material_thickness, ZComponent=0)  # -> Vector, Length
slot_head = Move(Geometry=slot_head_rect.Rectangle, Motion=vector_xyz.Vector)  # -> Geometry, Transform
slot_neck = Move(Geometry=slot_neck_rect.Rectangle, Motion=vector_xyz_2.Vector)  # -> Geometry, Transform
master_slot = RegionUnion(Curves=[slot_head.Geometry, slot_neck.Geometry, slot_long_rect.Rectangle])

# ---- group: master key
scale_down_key_from_slot = Number(0.9)
multiplication = Multiplication(A=material_thickness, B=scale_down_key_from_slot)
multiplication_2 = Multiplication(A=slot_long_length, B=scale_down_key_from_slot)
multiplication_3 = Multiplication(A=slot_head_length, B=scale_down_key_from_slot)
dom_5 = Domain(DomainStart=expr("-x/2", multiplication_2), DomainEnd=expr("x/2", multiplication_2))
dom_6 = Domain(DomainStart=expr("-x/2", multiplication_3), DomainEnd=expr("x/2", multiplication_3))
key_long_rect = Rectangle(Plane=origin_point, XSize=dom_5, YSize=dom_4, Radius=0)  # -> Rectangle, Length
key_head_rect = Rectangle(Plane=origin_point, XSize=dom_6, YSize=material_thickness, Radius=0)  # -> Rectangle, Length
key_neck_rect = Rectangle(Plane=origin_point, XSize=dom, YSize=material_thickness, Radius=0)  # -> Rectangle, Length
vector_xyz_3 = VectorXYZ(XComponent=expr("x/2", 0), YComponent=expr("x*2", material_thickness), ZComponent=0)  # -> Vector, Length
vector_xyz_4 = VectorXYZ(XComponent=expr("x/2", 0), YComponent=material_thickness, ZComponent=0)  # -> Vector, Length
key_head = Move(Geometry=key_long_rect.Rectangle, Motion=vector_xyz_3.Vector)  # -> Geometry, Transform
key_neck = Move(Geometry=key_head_rect.Rectangle, Motion=vector_xyz_4.Vector)  # -> Geometry, Transform
master_key = RegionUnion(Curves=[key_head.Geometry, key_neck.Geometry, key_neck_rect.Rectangle])

# ---- group: polygon
segments_polygon = Slider(6, range=0..10)
radius_polygon = Slider(130, range=0..300)
radius_circle = Slider(19.178, range=0..60)
polygon = Polygon(Plane=origin_point, Radius=radius_polygon, Segments=segments_polygon, FilletRadius=0)  # -> Polygon, Length
circle = Circle(Plane=origin_point, Radius=radius_circle)

# ---- group: slot polygon array
scale_for_slot_placement = Number(0.76)
multiplication_4 = Multiplication(A=radius_polygon, B=scale_for_slot_placement)
vector_xyz_5 = VectorXYZ(XComponent=0, YComponent=multiplication_4, ZComponent=0)  # -> Vector, Length
move = Move(Geometry=master_slot, Motion=vector_xyz_5.Vector)  # -> Geometry, Transform
polar_array = PolarArray(Geometry=move.Geometry, Plane=origin_point, Count=segments_polygon, Angle=6.283185307)  # -> Geometry, Transform

# ---- group: rect with key
_1_2_width_rect = Slider(120, range=0..200)
height_rect = Slider(160, range=0..400)
dom_7 = Domain(DomainStart=expr("-x/2", _1_2_width_rect), DomainEnd=expr("x/2", _1_2_width_rect))
vector_xyz_6 = VectorXYZ(XComponent=0, YComponent=height_rect, ZComponent=0)  # -> Vector, Length
rectangle = Rectangle(Plane=origin_point, XSize=dom_7, YSize=height_rect, Radius=0)  # -> Rectangle, Length
move_2 = Move(Geometry=master_key, Motion=vector_xyz_6.Vector)  # -> Geometry, Transform
flatten_tree = FlattenTree(Tree=move_2.Geometry, Path="{0}")

# ---- group: Bake these
region_difference = RegionDifference(CurvesA=polygon.Polygon, CurvesB=[circle, polar_array.Geometry])
region_union = RegionUnion(Curves=[flatten_tree, rectangle.Rectangle])
